# Dynamo graph MEP_AutoAvoid_ARC_STC_Player.dyn
# Dynamo Player entry for MEP auto-avoid ARC/STC (Revit 2023). Set ProjectRoot then Play.

# note: Dynamo Player — MEP vs ARC/STC/MEP (Revit 2023)
projectRoot = String("F:\For Cursor\BIM-Dynamo-MEP-ClashAvoidance")  # graph input
runMode = String("DetectOnly")  # graph input
ARC_Filter = String("ARC")  # graph input
STC_Filter = String("STC")  # graph input
clearanceScale = DoubleSlider(1, Max=3, Min=0.5, Step=0.1)  # graph input
preferOffsetAxis = String("Z")  # graph input
maxOffsetMm = DoubleSlider(600, Max=2000, Min=50, Step=50)  # graph input
offsetStepMm = DoubleSlider(50, Max=200, Min=10, Step=10)  # graph input
includeMEPvsMEP = BoolSelector(true)  # graph input
reportPath = String("(auto)")  # graph input
playerRunner = PythonNode(IN[0]=projectRoot, IN[1]=runMode, IN[2]=ARC_Filter, IN[3]=STC_Filter, IN[4]=clearanceScale, IN[5]=preferOffsetAxis, IN[6]=maxOffsetMm, IN[7]=offsetStepMm, IN[8]=includeMEPvsMEP, IN[9]=reportPath)  # IronPython2
getSummary = List.GetItemAtIndex(list=playerRunner)
summary = Watch(getSummary)  # graph output
getReportPath = List.GetItemAtIndex(list=playerRunner)
reportPathOut = Watch(getReportPath)  # graph output
getClashCount = List.GetItemAtIndex(list=playerRunner)
clashCount = Watch(getClashCount)  # graph output
getMepVsMep = List.GetItemAtIndex(list=playerRunner)
mepVsMepCount = Watch(getMepVsMep)  # graph output
getWarnings = List.GetItemAtIndex(list=playerRunner)
warnings = Watch(getWarnings)  # graph output
