# Dynamo graph MEP_Clash_Report_Player.dyn (Dynamo 2.13.1.3887)
# author: MEP-Avoid-Agent
# Phase 1 MEP Clash Report - Dynamo Player Ready
# Select MEP (Pipe/Duct) and obstacles, detect vertical clearance violations (incl. insulation). 100mm default.

# group: INPUTS (Dynamo Player)
# These inputs appear in Dynamo Player UI
n1_select_mep_pipe_duct = DSModelElementsSelection(Renamable=true, Name="1. Select MEP (Pipe/Duct)", IsSetAsInput=true, IsSetAsOutput=false, Excluded=false, ShowGeometry=false, X=100, Y=100)  # "1. Select MEP (Pipe/Duct)"; graph input
n2_select_obstacles = DSModelElementsSelection(Renamable=true, Name="2. Select Obstacles", IsSetAsInput=true, IsSetAsOutput=false, Excluded=false, ShowGeometry=false, X=100, Y=250)  # "2. Select Obstacles"; graph input
n3_clearance_mm = DoubleSlider(100, range=0..500 step 10, Renamable=true, Name="3. Clearance (mm)", IsSetAsInput=true, IsSetAsOutput=false, Excluded=false, ShowGeometry=false, X=100, Y=400)  # "3. Clearance (mm)"; graph input
n4_merge_gap_mm = DoubleSlider(300, range=0..1000 step 50, Renamable=true, Name="4. Merge Gap (mm)", IsSetAsInput=true, IsSetAsOutput=false, Excluded=false, ShowGeometry=false, X=100, Y=500)  # "4. Merge Gap (mm)"; graph input

mep_clash_detect = Python(IN[0]=n1_select_mep_pipe_duct, IN[1]=n2_select_obstacles, IN[2]=n3_clearance_mm, IN[3]=n4_merge_gap_mm, Renamable=false, Name="MEP Clash Detect (incl. insulation)", IsSetAsInput=false, IsSetAsOutput=false, Excluded=false, ShowGeometry=false, X=550, Y=250)  # IronPython2
# ---------- mep_clash_detect.python (192 lines) ----------
# MEP Clash Report — Dynamo Player (Phase 1)
# =============================================
# Detects vertical clearance violations between
# selected MEP (Pipe/Duct) and obstacle models.
# Includes insulation in measurement.
# Does NOT modify the model.

import clr
clr.AddReference("RevitAPI")
clr.AddReference("RevitServices")
clr.AddReference("RevitNodes")

from Autodesk.Revit.DB import (
    FilteredElementCollector, BuiltInCategory,
    BoundingBoxXYZ, XYZ, ElementId,
)
from Autodesk.Revit.DB.Plumbing import PipeInsulation
from Autodesk.Revit.DB.Mechanical import DuctInsulation
from RevitServices.Persistence import DocumentManager

import Revit
clr.ImportExtensions(Revit.Elements)

doc = DocumentManager.Instance.CurrentDBDocument
FPM = 1.0 / 304.8

SUP = {
    int(BuiltInCategory.OST_PipeCurves),
    int(BuiltInCategory.OST_DuctCurves),
}

def uw(e):
    try: return e.InternalElement
    except: return e

def uwl(els):
    if not isinstance(els, (list, tuple)): els = [els]
    return [uw(e) for e in els if e is not None]

def cid(e):
    return e.Category.Id.IntegerValue if e.Category else -1

def f2m(ft): return ft / FPM

class Env(object):
    __slots__ = ("eid","mnx","mny","mnz","mxx","mxy","mxz","ins","cat")
    def __init__(s,eid,mnx,mny,mnz,mxx,mxy,mxz,ins,cat):
        s.eid=eid;s.mnx=mnx;s.mny=mny;s.mnz=mnz
        s.mxx=mxx;s.mxy=mxy;s.mxz=mxz;s.ins=ins;s.cat=cat
    @property
    def otz(s): return s.mxz
    @property
    def obz(s): return s.mnz
    def oxy(s,o):
        return s.mnx<o.mxx and s.mxx>o.mnx and s.mny<o.mxy and s.mxy>o.mny

def fi(doc,hid):
    out=[]
    for b,c in [(BuiltInCategory.OST_PipeInsulations,PipeInsulation),
                (BuiltInCategory.OST_DuctInsulations,DuctInsulation)]:
        try:
            col=FilteredElementCollector(doc).OfCategory(b).WhereElementIsNotElementType().ToElements()
            for i in col:
                if i.HostElementId==hid: out.append(i)
        except: pass
    return out

def ge(elem,doc):
    bb=elem.get_BoundingBox(None)
    if bb is None: return None
    hid=elem.Id
    ins=fi(doc,hid)
    hi=len(ins)>0
    mnx,mny,mnz=bb.Min.X,bb.Min.Y,bb.Min.Z
    mxx,mxy,mxz=bb.Max.X,bb.Max.Y,bb.Max.Z
    for i in ins:
        ib=i.get_BoundingBox(None)
        if ib is None: continue
        mnx=min(mnx,ib.Min.X);mny=min(mny,ib.Min.Y);mnz=min(mnz,ib.Min.Z)
        mxx=max(mxx,ib.Max.X);mxy=max(mxy,ib.Max.Y);mxz=max(mxz,ib.Max.Z)
    cn=elem.Category.Name if elem.Category else ""
    return Env(hid.IntegerValue,mnx,mny,mnz,mxx,mxy,mxz,hi,cn)

class CZ(object):
    __slots__=("sid","oids","me","oes","gap","req","wbz","ox0","ox1","oy0","oy1","sk")
    def __init__(s,sid,me,oe,gap,req):
        s.sid=sid;s.oids=[oe.eid];s.me=me;s.oes=[oe]
        s.gap=gap;s.req=req;s.wbz=oe.obz
        s.ox0=max(me.mnx,oe.mnx);s.ox1=min(me.mxx,oe.mxx)
        s.oy0=max(me.mny,oe.mny);s.oy1=min(me.mxy,oe.mxy)
        s.sk=None
    @property
    def ic(s): return s.gap<s.req
    def mg(s,o):
        s.oids.extend(o.oids);s.oes.extend(o.oes)
        s.wbz=min(s.wbz,o.wbz);s.gap=min(s.gap,o.gap)
        s.ox0=min(s.ox0,o.ox0);s.ox1=max(s.ox1,o.ox1)
        s.oy0=min(s.oy0,o.oy0);s.oy1=max(s.oy1,o.oy1)

def det(se,oe,cm):
    rq=cm*FPM;out={}
    for m in se:
        zs=[]
        for o in oe:
            if not m.oxy(o): continue
            if m.mnz>=o.mxz: g=m.mnz-o.mxz
            elif o.mnz>=m.mxz: g=o.mnz-m.mxz
            else: g=-1.0
            z=CZ(m.eid,m,o,g,rq)
            if z.ic: zs.append(z)
        if zs: out[m.eid]=zs
    return out

def mz(cd,gm):
    mg=gm*FPM
    for sid,zs in cd.items():
        if len(zs)<=1: continue
        zs.sort(key=lambda z:z.ox0)
        mr=[zs[0]]
        for z in zs[1:]:
            p=mr[-1]
            if (z.ox0-p.ox1)<mg and (p.oy0<z.oy1 and p.oy1>z.oy0): p.mg(z)
            else: mr.append(z)
        cd[sid]=mr
    return cd

def rpt(cd,sk):
    ls=[];cc=0
    ls.append("="*60)
    ls.append("  MEP CLASH / CLEARANCE REPORT")
    ls.append("  Clearance target (incl. insulation)")
    ls.append("="*60)
    ls.append("")
    if not cd and not sk:
        ls.append("No clashes detected. All clear.")
        return "\n".join(ls),0,len(sk)
    for sid,zones in sorted(cd.items()):
        for z in zones:
            cc+=1
            ls.append("[CLASH] Subject #{} ({})".format(sid,z.me.cat))
            ls.append("  vs Obstacle(s): {}".format(", ".join("#{}".format(o) for o in z.oids)))
            gm=f2m(z.gap);rm=f2m(z.req)
            if z.gap<0: ls.append("  Gap: INTERSECTING")
            else: ls.append("  Gap: {:.0f} mm  (required: {:.0f} mm)".format(gm,rm))
            ls.append("  MEP top Z: {:.1f} mm | Obstacle bottom Z: {:.1f} mm".format(f2m(z.me.otz),f2m(z.wbz)))
            ls.append("  MEP insulated: {}".format("Yes" if z.me.ins else "No"))
            for oe in z.oes:
                ls.append("    Obs #{} ({}) insulated: {}".format(oe.eid,oe.cat,"Yes" if oe.ins else "No"))
            ls.append("")
    if sk:
        ls.append("-"*40)
        ls.append("SKIPPED (unsupported type):")
        for sid,r,d in sk:
            ls.append("  #{} - {} ({})".format(sid,r,d))
        ls.append("")
    sc=len(sk)
    ls[4]="Clashes: {}  |  Skipped: {}".format(cc,sc)
    return "\n".join(ls),cc,sc

# ── MAIN ──
sr=IN[0] if isinstance(IN[0],list) else [IN[0]] if IN[0] else []
or_=IN[1] if isinstance(IN[1],list) else [IN[1]] if IN[1] else []
cm=IN[2] if IN[2] is not None else 100
gm=IN[3] if IN[3] is not None else 300

ss=uwl(sr);os=uwl(or_)
er=[]
if not ss: er.append("No MEP subjects selected.")
if not os: er.append("No obstacle models selected.")
if er:
    OUT=["\n".join(["ERROR: "+e for e in er]),0,0]
else:
    sup=[];sk=[]
    for e in ss:
        if cid(e) in SUP: sup.append(e)
        else:
            cn=e.Category.Name if e.Category else "Unknown"
            sk.append((e.Id.IntegerValue,"SKIP_NOT_PIPE_DUCT",cn))
    if not sup:
        m="No supported MEP (Pipe/Duct) in selection."
        if sk: m+="\nSkipped: "+", ".join("#{} ({})".format(s[0],s[2]) for s in sk)
        OUT=[m,0,len(sk)]
    else:
        se=[v for v in [ge(e,doc) for e in sup] if v]
        oe=[v for v in [ge(e,doc) for e in os] if v]
        if not oe:
            OUT=["ERROR: Could not read obstacle geometry.",0,0]
        else:
            cd=det(se,oe,cm)
            cd=mz(cd,gm)
            txt,cc,sc=rpt(cd,sk)
            OUT=[txt,cc,sc]
# ----------------------------------------

# group: OUTPUTS
# Clash report results
clash_report = Watch(mep_clash_detect.OUT_0, Renamable=true, Name="Clash Report", IsSetAsInput=false, IsSetAsOutput=true, Excluded=false, ShowGeometry=false, X=1000, Y=200)  # graph output
clash_count = Watch(mep_clash_detect.OUT_1, Renamable=true, Name="Clash Count", IsSetAsInput=false, IsSetAsOutput=true, Excluded=false, ShowGeometry=false, X=1000, Y=400)  # graph output
skipped_count = Watch(mep_clash_detect.OUT_2, Renamable=true, Name="Skipped Count", IsSetAsInput=false, IsSetAsOutput=true, Excluded=false, ShowGeometry=false, X=1000, Y=500)  # graph output
