# Dynamo graph MEP_Clash_Report_Player_CPython3.dyn (Dynamo 2.13.1.3887)
# author: MEP-Avoid-Agent
# Phase 1 (CPython3) MEP Clash Report - Dynamo Player Ready. Select MEP (Pipe/Duct) and obstacles, detect vertical clearance violations (incl. insulation). 100mm default.

# group: INPUTS (Dynamo Player)
DSModelElementsSelection = DSModelElementsSelection(Renamable=true, Name="1. Select MEP (Pipe/Duct)", IsSetAsInput=true, IsSetAsOutput=false, Excluded=false, ShowGeometry=true, X=119, Y=109)  # graph input
DSModelElementsSelection_2 = DSModelElementsSelection(Renamable=true, Name="2. Select Obstacles", IsSetAsInput=true, IsSetAsOutput=false, Excluded=false, ShowGeometry=true, X=119, Y=269)  # graph input
doubleSlider = DoubleSlider(100, range=0..500 step 10, Renamable=true, Name="3. Clearance (mm)", IsSetAsInput=true, IsSetAsOutput=false, Excluded=false, ShowGeometry=true, X=119, Y=429)  # graph input
doubleSlider_2 = DoubleSlider(300, range=0..1000 step 50, Renamable=true, Name="4. Merge Gap (mm)", IsSetAsInput=true, IsSetAsOutput=false, Excluded=false, ShowGeometry=true, X=119, Y=539)  # graph input

python = Python(IN[0]=DSModelElementsSelection, IN[1]=DSModelElementsSelection_2, IN[2]=doubleSlider, IN[3]=doubleSlider_2, Renamable=false, Name="Python Script", IsSetAsInput=false, IsSetAsOutput=false, Excluded=false, ShowGeometry=true, X=580, Y=270)  # CPython3
# ---------- python.python (246 lines) ----------
import clr
clr.AddReference("RevitAPI")
clr.AddReference("RevitServices")
clr.AddReference("RevitNodes")

from Autodesk.Revit.DB import (
    FilteredElementCollector, BuiltInCategory,
    BoundingBoxXYZ, XYZ, ElementId,
)
from Autodesk.Revit.DB.Plumbing import PipeInsulation
from Autodesk.Revit.DB.Mechanical import DuctInsulation
from RevitServices.Persistence import DocumentManager

import Revit
clr.ImportExtensions(Revit.Elements)

doc = DocumentManager.Instance.CurrentDBDocument
FPM = 1.0 / 304.8

SUP = {
    int(BuiltInCategory.OST_PipeCurves),
    int(BuiltInCategory.OST_DuctCurves),
}

def uw(e):
    try:
        return e.InternalElement
    except:
        return e

def uwl(els):
    if not isinstance(els, (list, tuple)):
        els = [els]
    return [uw(e) for e in els if e is not None]

def cid(e):
    return e.Category.Id.IntegerValue if e.Category else -1

def f2m(ft):
    return ft / FPM

class Env(object):
    def __init__(self, eid, mnx, mny, mnz, mxx, mxy, mxz, ins, cat):
        self.eid = eid
        self.mnx = mnx
        self.mny = mny
        self.mnz = mnz
        self.mxx = mxx
        self.mxy = mxy
        self.mxz = mxz
        self.ins = ins
        self.cat = cat
    @property
    def otz(self):
        return self.mxz
    @property
    def obz(self):
        return self.mnz
    def oxy(self, o):
        return (self.mnx < o.mxx and self.mxx > o.mnx and
                self.mny < o.mxy and self.mxy > o.mny)

def fi(doc, hid):
    out = []
    for b, c in [(BuiltInCategory.OST_PipeInsulations, PipeInsulation),
                 (BuiltInCategory.OST_DuctInsulations, DuctInsulation)]:
        try:
            col = (FilteredElementCollector(doc)
                   .OfCategory(b)
                   .WhereElementIsNotElementType()
                   .ToElements())
            for i in col:
                if i.HostElementId == hid:
                    out.append(i)
        except:
            pass
    return out

def ge(elem, doc):
    bb = elem.get_BoundingBox(None)
    if bb is None:
        return None
    hid = elem.Id
    ins = fi(doc, hid)
    hi = len(ins) > 0
    mnx, mny, mnz = bb.Min.X, bb.Min.Y, bb.Min.Z
    mxx, mxy, mxz = bb.Max.X, bb.Max.Y, bb.Max.Z
    for i in ins:
        ib = i.get_BoundingBox(None)
        if ib is None:
            continue
        mnx = min(mnx, ib.Min.X)
        mny = min(mny, ib.Min.Y)
        mnz = min(mnz, ib.Min.Z)
        mxx = max(mxx, ib.Max.X)
        mxy = max(mxy, ib.Max.Y)
        mxz = max(mxz, ib.Max.Z)
    cn = elem.Category.Name if elem.Category else ""
    return Env(hid.IntegerValue, mnx, mny, mnz, mxx, mxy, mxz, hi, cn)

class CZ(object):
    def __init__(self, sid, me, oe, gap, req):
        self.sid = sid
        self.oids = [oe.eid]
        self.me = me
        self.oes = [oe]
        self.gap = gap
        self.req = req
        self.wbz = oe.obz
        self.ox0 = max(me.mnx, oe.mnx)
        self.ox1 = min(me.mxx, oe.mxx)
        self.oy0 = max(me.mny, oe.mny)
        self.oy1 = min(me.mxy, oe.mxy)
        self.sk = None
    @property
    def ic(self):
        return self.gap < self.req
    def mg(self, o):
        self.oids.extend(o.oids)
        self.oes.extend(o.oes)
        self.wbz = min(self.wbz, o.wbz)
        self.gap = min(self.gap, o.gap)
        self.ox0 = min(self.ox0, o.ox0)
        self.ox1 = max(self.ox1, o.ox1)
        self.oy0 = min(self.oy0, o.oy0)
        self.oy1 = max(self.oy1, o.oy1)

def det(se, oe, cm):
    rq = cm * FPM
    out = {}
    for m in se:
        zs = []
        for o in oe:
            if not m.oxy(o):
                continue
            if m.mnz >= o.mxz:
                g = m.mnz - o.mxz
            elif o.mnz >= m.mxz:
                g = o.mnz - m.mxz
            else:
                g = -1.0
            z = CZ(m.eid, m, o, g, rq)
            if z.ic:
                zs.append(z)
        if zs:
            out[m.eid] = zs
    return out

def mzn(cd, gm):
    mgf = gm * FPM
    for sid, zs in cd.items():
        if len(zs) <= 1:
            continue
        zs.sort(key=lambda z: z.ox0)
        mr = [zs[0]]
        for z in zs[1:]:
            p = mr[-1]
            if (z.ox0 - p.ox1) < mgf and (p.oy0 < z.oy1 and p.oy1 > z.oy0):
                p.mg(z)
            else:
                mr.append(z)
        cd[sid] = mr
    return cd

def rpt(cd, sk):
    ls = []
    cc = 0
    ls.append("=" * 60)
    ls.append("  MEP CLASH / CLEARANCE REPORT")
    ls.append("  Clearance target (incl. insulation)")
    ls.append("=" * 60)
    ls.append("")
    if not cd and not sk:
        ls.append("No clashes detected. All clear.")
        return "\n".join(ls), 0, len(sk)
    for sid, zones in sorted(cd.items()):
        for z in zones:
            cc += 1
            ls.append("[CLASH] Subject #{} ({})".format(sid, z.me.cat))
            ls.append("  vs Obstacle(s): {}".format(
                ", ".join("#{}".format(o) for o in z.oids)))
            gm = f2m(z.gap)
            rm = f2m(z.req)
            if z.gap < 0:
                ls.append("  Gap: INTERSECTING")
            else:
                ls.append("  Gap: {:.0f} mm  (required: {:.0f} mm)".format(gm, rm))
            ls.append("  MEP top Z: {:.1f} mm | Obstacle bottom Z: {:.1f} mm".format(
                f2m(z.me.otz), f2m(z.wbz)))
            ls.append("  MEP insulated: {}".format("Yes" if z.me.ins else "No"))
            for oe in z.oes:
                ls.append("    Obs #{} ({}) insulated: {}".format(
                    oe.eid, oe.cat, "Yes" if oe.ins else "No"))
            ls.append("")
    if sk:
        ls.append("-" * 40)
        ls.append("SKIPPED (unsupported type):")
        for sid, r, d in sk:
            ls.append("  #{} - {} ({})".format(sid, r, d))
        ls.append("")
    sc = len(sk)
    ls[4] = "Clashes: {}  |  Skipped: {}".format(cc, sc)
    return "\n".join(ls), cc, sc

# MAIN
subjects_raw = IN[0] if isinstance(IN[0], list) else [IN[0]] if IN[0] else []
obstacles_raw = IN[1] if isinstance(IN[1], list) else [IN[1]] if IN[1] else []
cm = IN[2] if IN[2] is not None else 100
gm = IN[3] if IN[3] is not None else 300

ss = uwl(subjects_raw)
os = uwl(obstacles_raw)

er = []
if not ss:
    er.append("No MEP subjects selected.")
if not os:
    er.append("No obstacle models selected.")

if er:
    OUT = "\n".join(["ERROR: " + e for e in er])
else:
    sup = []
    sk = []
    for e in ss:
        if cid(e) in SUP:
            sup.append(e)
        else:
            cn = e.Category.Name if e.Category else "Unknown"
            sk.append((e.Id.IntegerValue, "SKIP_NOT_PIPE_DUCT", cn))
    if not sup:
        msg = "No supported MEP (Pipe/Duct) in selection."
        if sk:
            msg += "\nSkipped: " + ", ".join(
                "#{} ({})".format(s[0], s[2]) for s in sk)
        OUT = msg
    else:
        se = [v for v in [ge(e, doc) for e in sup] if v]
        oee = [v for v in [ge(e, doc) for e in os] if v]
        if not oee:
            OUT = "ERROR: Could not read obstacle geometry."
        else:
            cd = det(se, oee, cm)
            cd = mzn(cd, gm)
            txt, cc, sc = rpt(cd, sk)
            OUT = txt
# ----------------------------------------
watch = Watch(python, Renamable=true, Name="Clash Report Output", IsSetAsInput=false, IsSetAsOutput=true, Excluded=false, ShowGeometry=true, X=950, Y=270)  # graph output
