# Dynamo graph FaceOpening_CBWD_BL_Sync_Player.dyn
# Face Opening -> CBWD B.L. Player browse: dynamo folder. ProjectRoot: paste same dynamo path OR project folder. Revit 2023.

projectRoot = String("PASTE_DYNAMO_OR_PROJECT_FOLDER")  # graph input
selectionMode = String("AllOpenings")  # graph input
familyNameContains = String("Face Opening")  # graph input
parameterName = String("CBWD B.L.")  # graph input
# note: Player folder = dynamo/
reportPath = String("(auto)")  # graph input
run_sync_cbwd_b_l = PythonNode(IN[0]=projectRoot, IN[1]=selectionMode, IN[2]=familyNameContains, IN[3]=parameterName, IN[4]=reportPath)  # IronPython2
resultList = Watch(run_sync_cbwd_b_l)  # graph output
getItemAtIndex = List.GetItemAtIndex(list=run_sync_cbwd_b_l)
summary = Watch(getItemAtIndex)  # graph output
getItemAtIndex_2 = List.GetItemAtIndex(list=run_sync_cbwd_b_l)
reportPathOut = Watch(getItemAtIndex_2)  # graph output
getItemAtIndex_3 = List.GetItemAtIndex(list=run_sync_cbwd_b_l)
successCount = Watch(getItemAtIndex_3)  # graph output
getItemAtIndex_4 = List.GetItemAtIndex(list=run_sync_cbwd_b_l)
skippedCount = Watch(getItemAtIndex_4)  # graph output
getItemAtIndex_5 = List.GetItemAtIndex(list=run_sync_cbwd_b_l)
warnings = Watch(getItemAtIndex_5)  # graph output
getItemAtIndex_6 = List.GetItemAtIndex(list=run_sync_cbwd_b_l)
status = Watch(getItemAtIndex_6)  # graph output
