# Dynamo graph FaceOpening_CBWD_BL_Sync_Player.dyn (Dynamo 2.13.1.3887)
# author: Cursor Agent
# Face Opening bottom Elevation -> CBWD B.L. Player browse dynamo folder. ProjectRoot = same dynamo path OK. Revit 2023 / Dynamo 2.13.

n1_projectroot = String("PASTE_DYNAMO_OR_PROJECT_FOLDER", Renamable=true, Name="1. ProjectRoot", IsSetAsInput=true, IsSetAsOutput=false, Excluded=false, ShowGeometry=true, X=80, Y=80)  # "1. ProjectRoot"; graph input
n2_selectionmode = String("AllOpenings", Renamable=true, Name="2. SelectionMode", IsSetAsInput=true, IsSetAsOutput=false, Excluded=false, ShowGeometry=true, X=80, Y=190)  # "2. SelectionMode"; graph input
n3_familynamecontains = String("Face Opening", Renamable=true, Name="3. FamilyNameContains", IsSetAsInput=true, IsSetAsOutput=false, Excluded=false, ShowGeometry=true, X=80, Y=300)  # "3. FamilyNameContains"; graph input
n4_parametername = String("CBWD B.L.", Renamable=true, Name="4. ParameterName", IsSetAsInput=true, IsSetAsOutput=false, Excluded=false, ShowGeometry=true, X=80, Y=410)  # "4. ParameterName"; graph input
# note: Player = dynamo folder
n5_reportpath = String("(auto)", Renamable=true, Name="5. ReportPath", IsSetAsInput=true, IsSetAsOutput=false, Excluded=false, ShowGeometry=true, X=80, Y=520)  # "5. ReportPath"; graph input
python = Python(IN[0]=n1_projectroot, IN[1]=n2_selectionmode, IN[2]=n3_familynamecontains, IN[3]=n4_parametername, IN[4]=n5_reportpath, Renamable=false, Name="Python Script", IsSetAsInput=false, IsSetAsOutput=false, Excluded=false, ShowGeometry=true, X=520, Y=200)  # IronPython2
# ---------- python.python (76 lines) ----------
# Face Opening Elevation -> CBWD B.L. (Dynamo Player / IronPython2)
import sys, os

def _s(v):
    if v is None:
        return ''
    try:
        return v.ToString() if hasattr(v, 'ToString') else str(v)
    except:
        return str(v)

def _is_root(p):
    return (
        p and os.path.isdir(p)
        and os.path.isfile(os.path.join(p, 'python', 'sync_cbwd_bl.py'))
        and os.path.isfile(os.path.join(p, 'config', 'sync_rules.json'))
    )

def resolve_root(raw):
    path = _s(raw).strip().strip('"').strip("'")
    if (not path) or path.lower() in (
        'paste_dynamo_or_project_folder', 'paste_your_path_here',
        'your_path', 'todo', '(auto)', 'auto', 'null', 'none', ''
    ):
        return None, 'Paste ProjectRoot = Dynamo Player folder (dynamo) OR project folder'
    if path.lower().endswith('.dyn') and os.path.isfile(path):
        path = os.path.dirname(path)
    if not os.path.isdir(path):
        return None, 'Path not found: ' + path
    cands = [path]
    if os.path.basename(os.path.normpath(path)).lower() == 'dynamo':
        cands.append(os.path.dirname(path))
    parent = os.path.dirname(os.path.normpath(path))
    if parent and parent not in cands:
        cands.append(parent)
    for c in cands:
        if _is_root(c):
            return c, ''
    return None, 'Need ...\\revit-face-opening-cbwd-bl or ...\\dynamo'

OUT = ['init', '', 0, 0, 'init', 'ERROR']
try:
    root, note = resolve_root(IN[0] if len(IN) > 0 else '')
    if not root:
        OUT = ['ProjectRoot could not be resolved', '', 0, 0, note, 'ERROR']
    else:
        py = os.path.join(root, 'python')
        script = os.path.join(py, 'sync_cbwd_bl.py')
        if py not in sys.path:
            sys.path.insert(0, py)
        inputs = list(IN)
        while len(inputs) < 5:
            inputs.append(None)
        inputs[0] = root
        ns = {'IN': inputs, 'OUT': None}
        f = open(script, 'r')
        code = f.read()
        f.close()
        exec(code, ns)
        out = ns.get('OUT')
        if out is None and callable(ns.get('run')):
            out = ns['run'](inputs)
        if out is None or (not isinstance(out, list)) or len(out) < 6:
            OUT = ['Bad OUT from sync_cbwd_bl', '', 0, 0, 'Script did not return 6 outputs', 'ERROR']
        else:
            OUT = list(out)[:6]
            if note:
                w = _s(OUT[4])
                OUT[4] = (note + '; ' + w) if w and w != 'none' else note
except Exception as ex:
    try:
        import traceback
        tb = traceback.format_exc()
    except:
        tb = str(ex)
    OUT = ['Loader exception: ' + str(ex), '', 0, 0, tb, 'ERROR']
# ----------------------------------------
resultList = Watch(python, Renamable=true, Name="ResultList", IsSetAsInput=false, IsSetAsOutput=true, Excluded=false, ShowGeometry=true, X=1100, Y=40)  # graph output
getItemAtIndex = List.GetItemAtIndex(list=python, X=820, Y=140)
summary = Watch(getItemAtIndex, Renamable=true, Name="Summary", IsSetAsInput=false, IsSetAsOutput=true, Excluded=false, ShowGeometry=true, X=1100, Y=140)  # graph output
getItemAtIndex_2 = List.GetItemAtIndex(list=python, X=820, Y=235)
reportPathOut = Watch(getItemAtIndex_2, Renamable=true, Name="ReportPathOut", IsSetAsInput=false, IsSetAsOutput=true, Excluded=false, ShowGeometry=true, X=1100, Y=235)  # graph output
getItemAtIndex_3 = List.GetItemAtIndex(list=python, X=820, Y=330)
successCount = Watch(getItemAtIndex_3, Renamable=true, Name="SuccessCount", IsSetAsInput=false, IsSetAsOutput=true, Excluded=false, ShowGeometry=true, X=1100, Y=330)  # graph output
getItemAtIndex_4 = List.GetItemAtIndex(list=python, X=820, Y=425)
skippedCount = Watch(getItemAtIndex_4, Renamable=true, Name="SkippedCount", IsSetAsInput=false, IsSetAsOutput=true, Excluded=false, ShowGeometry=true, X=1100, Y=425)  # graph output
getItemAtIndex_5 = List.GetItemAtIndex(list=python, X=820, Y=520)
warnings = Watch(getItemAtIndex_5, Renamable=true, Name="Warnings", IsSetAsInput=false, IsSetAsOutput=true, Excluded=false, ShowGeometry=true, X=1100, Y=520)  # graph output
getItemAtIndex_6 = List.GetItemAtIndex(list=python, X=820, Y=615)
status = Watch(getItemAtIndex_6, Renamable=true, Name="Status", IsSetAsInput=false, IsSetAsOutput=true, Excluded=false, ShowGeometry=true, X=1100, Y=615)  # graph output
